# Grasshopper definition categorical_optimization.gh (Grasshopper 1.0.8)
# plug-ins: Tunny

# ----
# Optimization was previously based on using NumberSlider,
# but to allow for categorical optimization,
# ValueList can now be used as a variable.
# Categorical is when there is no distance between variables.
# 
# Since these are algorithms, they are independent of each other,
# so categorical optimization is appropriate
tunny_value_list = TunnyValueList({"Tuna": 1, "Salmon": 2, "Cod": 3, "Trout": 4}, selected="Tuna")  # "<')))<<"

A = Slider(0.8, range=0.1..10)
B = Slider(8.8, range=0.1..10)
blackbox_function = BlackBoxFunction(G=tunny_value_list, A=A, B=B)
result = Number(blackbox_function)
tunny = Tunny(Variables=[tunny_value_list, A, B], Objectives=result)

# ==== cluster BlackBoxFunction
G = ClusterInput()
A = ClusterInput()
B = ClusterInput()
addition = Addition(A=A, B=B)
subtraction = Subtraction(A=A, B=B)
multiplication = Multiplication(A=A, B=B)
division = Division(A=A, B=B)
filter = StreamFilter(Gate=G, Stream0=addition, Stream1=subtraction, Stream2=multiplication, Stream3=division)
s_1 = ClusterOutput(filter)
