# Grasshopper definition sample.gh (Grasshopper 1.0.7)
# plug-ins: Tunny Info

# ----
# These slider are used for optimization as a variable.
# Nickname is recommended to make the results easier to understand.
x1 = Slider(-8.18, range=-10..10)
x2 = Slider(-7.49, range=-10..10)
x3 = Slider(-1.47, range=-10..10)

# ---- group: Booth function
expression = Expression(x1=x1, x2=x2, Expression="(x1+2*x2-7)^2 + (2*x1+x2-5)^2")

# ---- group: Brep Volume
pt = ConstructPoint(XCoordinate=x1, YCoordinate=x2, ZCoordinate=x3)
pt_2 = ConstructPoint(XCoordinate=0, YCoordinate=0, ZCoordinate=0)
box = Box2Pt(PointA=pt_2, PointB=pt, Plane=PlaneXY(0, 0, 0))
volume = Volume(Geometry=box)  # -> Volume, Centroid

# ---- group: Simple Addition
addition = Addition(A=x1, B=x2)

# ----
# objectives are
# combined into one
num = Number([addition, expression, volume.Volume])

# ----
# If mesh data is given in a list,
# only the first mesh will be saved
mesh = Mesh(box)

# ----
# Double-click the icon to open
# the optimization window.
tunny = Tunny(Variables=[x1, x2, x3], Objectives=num, ModelMesh=mesh)  # -> ResultVariables, ResultObjectives, ResultMesh
