# Grasshopper definition sample.gh (Grasshopper 1.0.7)
# plug-ins: Tunny Info

# ----
# Support genepool
genes = GenePool(Decimals=2, Maximum=10, Minimum=-10, Value=[-5.47203683, 5.950791, -6.701314661])

# ----
# These slider are used for optimization as a variable.
# Nickname is recommended to make the results easier to understand.
x1 = Slider(-1.21, range=-10..10)
x2 = Slider(-8.42, range=-10..10)
x3 = Slider(4.22, range=-10..10)

# ---- group: Booth function
expression = Expression(x1=x1, x2=x2, Expression="(x1+2*x2-7)^2 + (2*x1+x2-5)^2")

# ---- group: Geometry
pt = ConstructPoint(XCoordinate=x1, YCoordinate=x2, ZCoordinate=x3)
num2pt = NumbersToPoints(Numbers=genes, Mask=4)
box = Box2Pt(PointA=num2pt, PointB=pt, Plane=PlaneXY(0, 0, 0))
ln = Line(StartPoint=num2pt, EndPoint=pt)
volume = Volume(Geometry=box)  # -> Volume, Centroid

# ---- group: Simple Addition
addition = Addition(A=x1, B=x2)

# ----
# Multi attributes support
# The number of Attributes can be increased
# to any number as ZUI is supported
len = Length(Curve=ln)
brep = Brep(box)
crv = Curve(ln)
num = Number(genes)
constrfa = ConstructFishAttribute(Geometry=[brep, crv], Length=len, Genelist=num)

# ----
# Input the objective
# value separately.
booth_function = Number(expression)
brep_volume = Number(volume.Volume)
addition_2 = Number(addition)

# ----
# Double-click the icon to open
# the optimization window.
tunny = Tunny(Variables=[x1, x2, x3, genes], Objectives=[addition_2, booth_function, brep_volume], Attributes=constrfa)

# ----
# The Fish component
# handle the Tunny results.
fish = Fish([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])

fish_2 = Fish(tunny)
panel = Panel(fish)

# ----
# Results can be arrayed in Rhino's viewport
xy = XYPlane(Origin=Point(0, 0, 0))
fmarket = FishMarket(
    Fishes=fish,
    Plane=xy,
    XNum=Slider(10, range=0..10),
    XInterval=Slider(46, range=0..100),
    YInterval=Slider(60, range=0..100),
    TextSize=1)

# ----
# A breakdown of the analysis results can be retrieved by using the Deconstruct component.
# The paths in the data tree are matched to the trial numbers in the optimization.
deconf = DeconstructFish(Fishes=fish)  # -> Variables, Objectives, Attributes
panel_2 = Panel(deconf.Variables)
panel_3 = Panel(deconf.Objectives)
# Right-click and select "match outputs" to
# automatically generate outputs according
# to the Attribute set in the optimization.
deconfa = DeconstructFishAttribute(Attributes=deconf.Attributes)  # -> Geometry, Genelist, Length
panel_4 = Panel(deconfa.Genelist)
panel_5 = Panel(deconfa.Length)
panel_6 = Panel(deconfa.Geometry)

geo = Geometry(deconfa.Geometry)
